# Grasshopper definition ArchSegment.gh (Grasshopper 1.0.7)

angle = Slider(45, range=45..90)
width_mm = Slider(2260, range=0..5000)
height_mm = Slider(97, range=1..300)
length_mm = Slider(713, range=1..5000)
as_length = GetNumber(length_mm, AtLeast=1, AtMost=1, Maximum=1.797693135e+308, Minimum=-1.797693135e+308, TreeAccess=False)
as_angle = GetNumber(angle, AtLeast=1, AtMost=1, Maximum=1.797693135e+308, Minimum=-1.797693135e+308, TreeAccess=False)
as_height = GetNumber(height_mm, AtLeast=1, AtMost=1, Maximum=1.797693135e+308, Minimum=-1.797693135e+308, TreeAccess=False)
as_width = GetNumber(width_mm, AtLeast=1, AtMost=1, Maximum=1.797693135e+308, Minimum=-1.797693135e+308, TreeAccess=False)
X = UnitX(Factor=1)
python = GhPythonScript(length=as_length, angle=as_angle, height=as_height)  # -> out, a
# ---------- python: Python ----------
__author__ = "Benedict"
__version__ = "2025.09.02"

import rhinoscriptsyntax as rs
import math

a = height / math.tan(math.radians(angle))
#print(a)
length_top = length - 2*a
print(length_top / length)

out = length_top / length
# ---------- end python ----------
line = LineSDL(Start="0,0,0", Direction=X, Length=as_length)
pt = ConstructPoint(XCoordinate=0, YCoordinate=as_height, ZCoordinate=0)
multiplication = Multiplication(A=as_length, B="0.5")
move = Move(Geometry=line, Motion=pt)  # -> Geometry, Transform
pt_2 = ConstructPoint(XCoordinate=multiplication, YCoordinate=as_height, ZCoordinate=0)
Z = UnitZ(Factor=as_width)
scale = Scale(Geometry=move.Geometry, Center=pt_2, Factor=python.out)  # -> Geometry, Transform
end = EndPoints(Curve=line)  # -> Start, End
end_2 = EndPoints(Curve=scale.Geometry)  # -> Start, End
merge = Merge(Data1=end.Start, Data2=end.End, Data3=end_2.End, Data4=end_2.Start)
flatten = FlattenTree(Tree=merge, Path="{0}")
pline = PolyLine(Vertices=flatten, Closed="true")
boundary = BoundarySurfaces(Edges=pline)
xz = XZPlane(Origin=Point(0, 0, 0))
extr = Extrude(Base=boundary, Direction=Z)
cap = CapHoles(Brep=extr)
orient = Orient(Geometry=cap, Source=PlaneXY(0, 0, 0), Target=xz)  # -> Geometry, Transform
pi = Pi(Factor=1)
yz = YZPlane(Origin=Point(0, 0, 0))
rotate = Rotate(Geometry=orient.Geometry, Angle=pi, Plane=yz)  # -> Geometry, Transform
debrep = DeconstructBrep(Brep=rotate.Geometry)  # -> Faces, Edges, Vertices
item = ListItem(List=debrep.Faces, Index="4", Wrap=True)
item_2 = ListItem(List=debrep.Faces, Index="2", Wrap=True)

# ---- group: RH_OUT:AS_brep
brep = Brep(rotate.Geometry)

# ----
srf = Surface(item_2)
srf_2 = Surface(item)
area = Area(Geometry=srf)  # -> Area, Centroid
area_2 = Area(Geometry=srf_2)  # -> Area, Centroid
pl_origin = PlaneOrigin(Base=srf, Origin=area.Centroid)
pl_origin_2 = PlaneOrigin(Base=srf_2, Origin=area_2.Centroid)
rad = Radians(Degrees="-90")
prot = RotatePlane(Plane=pl_origin, Angle=rad)
rh_out_as_interface2 = Plane(prot)
rh_out_as_interface1 = Plane(pl_origin_2)
deplane = DeconstructPlane(Plane=rh_out_as_interface1)  # -> Origin, XAxis, YAxis, ZAxis
deplane_2 = DeconstructPlane(Plane=rh_out_as_interface2)  # -> Origin, XAxis, YAxis, ZAxis
vdis = VectorDisplay(Anchor=deplane.Origin, Vector=deplane.ZAxis)
vdis_2 = VectorDisplay(Anchor=deplane_2.Origin, Vector=deplane_2.ZAxis)
