# Grasshopper definition Girder.gh (Grasshopper 1.0.7)

grd_width = GetNumber(
    Slider(1550, range=1000..5000),
    AtLeast=1,
    AtMost=1,
    Maximum=1.797693135e+308,
    Minimum=-1.797693135e+308,
    TreeAccess=False)
grd_height = GetNumber(Slider(179, range=100..500), AtLeast=1, AtMost=1, Maximum=1.797693135e+308, Minimum=-1.797693135e+308, TreeAccess=False)
grd_length = GetNumber(
    Slider(4196, range=3000..20000),
    AtLeast=1,
    AtMost=1,
    Maximum=1.797693135e+308,
    Minimum=-1.797693135e+308,
    TreeAccess=False)
rectangle = Rectangle(Plane=PlaneXY(0, 0, 0), XSize=grd_length, YSize=grd_width, Radius=0)  # -> Rectangle, Length
boundary = BoundarySurfaces(Edges=rectangle.Rectangle)
Z = UnitZ(Factor=grd_height)
extr = Extrude(Base=boundary, Direction=Z)
rh_out_grd_brep = Brep(extr)
debrep = DeconstructBrep(Brep=extr)  # -> Faces, Edges, Vertices
division = Division(A=grd_width, B=2)
item = ListItem(List=debrep.Faces, Index="0", Wrap=True)
item_2 = ListItem(List=debrep.Faces, Index="5", Wrap=True)
item_3 = ListItem(List=debrep.Vertices, Index=4, Wrap=True)
pt = ConstructPoint(XCoordinate=0, YCoordinate=grd_width, ZCoordinate=0)
pt_2 = ConstructPoint(XCoordinate=2000, YCoordinate=division, ZCoordinate=0)
area = Area(Geometry=item)  # -> Area, Centroid
move = Move(Geometry=item_3, Motion=pt)  # -> Geometry, Transform
pl_origin = PlaneOrigin(Base=item, Origin=pt_2)
pl_origin_2 = PlaneOrigin(Base=item_2, Origin=move.Geometry)
pl_origin_3 = PlaneOrigin(Base=item_2, Origin=item_3)
rad = Radians(Degrees=90)
pflip = FlipPlane(Plane=pl_origin_3, ReverseX=False, ReverseY=False, SwapAxes=True)
pflip_2 = FlipPlane(Plane=pl_origin_2, ReverseX=False, ReverseY=False, SwapAxes=True)
prot = RotatePlane(Plane=pl_origin, Angle=rad)
rh_out_grd_interface1 = Plane(prot)
rh_out_grd_interface2 = Plane(pflip)
rh_out_grd_interface3 = Plane(pflip_2)
deplane = DeconstructPlane(Plane=rh_out_grd_interface1)  # -> Origin, XAxis, YAxis, ZAxis
deplane_2 = DeconstructPlane(Plane=rh_out_grd_interface3)  # -> Origin, XAxis, YAxis, ZAxis
deplane_3 = DeconstructPlane(Plane=rh_out_grd_interface2)  # -> Origin, XAxis, YAxis, ZAxis
vdis = VectorDisplay(Anchor=deplane.Origin, Vector=deplane.ZAxis)
vdis_2 = VectorDisplay(Anchor=deplane_2.Origin, Vector=deplane_2.ZAxis)
vdis_3 = VectorDisplay(Anchor=deplane_3.Origin, Vector=deplane_3.ZAxis)
