# Grasshopper definition Sidewalk.gh (Grasshopper 1.0.7)

wlk_width = GetNumber(
    Slider(1550, range=1000..5000),
    AtLeast=1,
    AtMost=1,
    Maximum=1.797693135e+308,
    Minimum=-1.797693135e+308,
    TreeAccess=False)
wlk_height = GetNumber(Slider(179, range=100..500), AtLeast=1, AtMost=1, Maximum=1.797693135e+308, Minimum=-1.797693135e+308, TreeAccess=False)
wlk_length = GetNumber(
    Slider(4196, range=3000..20000),
    AtLeast=1,
    AtMost=1,
    Maximum=1.797693135e+308,
    Minimum=-1.797693135e+308,
    TreeAccess=False)
rectangle = Rectangle(Plane=PlaneXY(0, 0, 0), XSize=wlk_length, YSize=wlk_width, Radius=0)  # -> Rectangle, Length
boundary = BoundarySurfaces(Edges=rectangle.Rectangle)
Z = UnitZ(Factor=wlk_height)
extr = Extrude(Base=boundary, Direction=Z)
rh_out_wlk_brep = Brep(extr)
debrep = DeconstructBrep(Brep=extr)  # -> Faces, Edges, Vertices
item = ListItem(List=debrep.Faces, Index=1, Wrap=True)
item_2 = ListItem(List=debrep.Vertices, Index=0, Wrap=True)
item_3 = ListItem(List=debrep.Faces, Index=3, Wrap=True)
item_4 = ListItem(List=debrep.Faces, Index="5", Wrap=True)
item_5 = ListItem(List=debrep.Faces, Index=4, Wrap=True)
pt = ConstructPoint(XCoordinate=0, YCoordinate=wlk_width, ZCoordinate=0)
item_6 = ListItem(List=debrep.Faces, Index=2, Wrap=True)
move = Move(Geometry=item_2, Motion=pt)  # -> Geometry, Transform
area = Area(Geometry=item)  # -> Area, Centroid
area_2 = Area(Geometry=item_3)  # -> Area, Centroid
area_3 = Area(Geometry=item_5)  # -> Area, Centroid
area_4 = Area(Geometry=item_6)  # -> Area, Centroid
pl_origin = PlaneOrigin(Base=item_4, Origin=move.Geometry)
pl_origin_2 = PlaneOrigin(Base=item_4, Origin=item_2)
pl_origin_3 = PlaneOrigin(Base=item, Origin=area.Centroid)
pl_origin_4 = PlaneOrigin(Base=item_3, Origin=area_2.Centroid)
pl_origin_5 = PlaneOrigin(Base=item_5, Origin=area_3.Centroid)
pl_origin_6 = PlaneOrigin(Base=item_6, Origin=area_4.Centroid)
pi = Pi(Factor=1)
pi_2 = Pi(Factor=1)
pi_3 = Pi(Factor=1)
pi_4 = Pi(Factor=1)
pflip = FlipPlane(Plane=pl_origin_2, ReverseX=False, ReverseY=False, SwapAxes=True)
pflip_2 = FlipPlane(Plane=pl_origin, ReverseX=False, ReverseY=False, SwapAxes=True)
prot = RotatePlane(Plane=pl_origin_3, Angle=pi)
prot_2 = RotatePlane(Plane=pl_origin_4, Angle=pi_2)
prot_3 = RotatePlane(Plane=pl_origin_5, Angle=pi_3)
prot_4 = RotatePlane(Plane=pl_origin_6, Angle=pi_4)
pflip_3 = FlipPlane(Plane=prot, ReverseX=False, ReverseY=False, SwapAxes=True)
pflip_4 = FlipPlane(Plane=prot_3, ReverseX=False, ReverseY=False, SwapAxes=True)
rh_out_wlk_interface3 = Plane(pflip)
rh_out_wlk_interface6 = Plane(pflip_3)
rh_out_wlk_interface4 = Plane(pflip_2)
rh_out_wlk_interface5 = Plane(prot_2)
rh_out_wlk_interface2 = Plane(pflip_4)
rh_out_wlk_interface1 = Plane(prot_4)
deplane = DeconstructPlane(Plane=rh_out_wlk_interface6)  # -> Origin, XAxis, YAxis, ZAxis
deplane_2 = DeconstructPlane(Plane=rh_out_wlk_interface4)  # -> Origin, XAxis, YAxis, ZAxis
deplane_3 = DeconstructPlane(Plane=rh_out_wlk_interface3)  # -> Origin, XAxis, YAxis, ZAxis
deplane_4 = DeconstructPlane(Plane=rh_out_wlk_interface5)  # -> Origin, XAxis, YAxis, ZAxis
deplane_5 = DeconstructPlane(Plane=rh_out_wlk_interface2)  # -> Origin, XAxis, YAxis, ZAxis
deplane_6 = DeconstructPlane(Plane=rh_out_wlk_interface1)  # -> Origin, XAxis, YAxis, ZAxis
vdis = VectorDisplay(Anchor=deplane.Origin, Vector=deplane.ZAxis)
vdis_2 = VectorDisplay(Anchor=deplane_2.Origin, Vector=deplane_2.ZAxis)
vdis_3 = VectorDisplay(Anchor=deplane_3.Origin, Vector=deplane_3.ZAxis)
vdis_4 = VectorDisplay(Anchor=deplane_4.Origin, Vector=deplane_4.ZAxis)
vdis_5 = VectorDisplay(Anchor=deplane_5.Origin, Vector=deplane_5.ZAxis)
vdis_6 = VectorDisplay(Anchor=deplane_6.Origin, Vector=deplane_6.ZAxis)
