# Grasshopper definition Spandrel.gh (Grasshopper 1.0.7)

rh_in_sp_width = Slider(401, range=0..1000)
rh_in_sp_height = Slider(185, range=0..1000)
rh_in_sp_length = Slider(1530, range=0..10000)
sp_width = GetNumber(rh_in_sp_width, AtLeast=1, AtMost=1, Maximum=1.797693135e+308, Minimum=-1.797693135e+308, TreeAccess=False)
sp_height = GetNumber(rh_in_sp_height, AtLeast=1, AtMost=1, Maximum=1.797693135e+308, Minimum=-1.797693135e+308, TreeAccess=False)
sp_length = GetNumber(rh_in_sp_length, AtLeast=1, AtMost=1, Maximum=1.797693135e+308, Minimum=-1.797693135e+308, TreeAccess=False)
rectangle = Rectangle(Plane=PlaneXY(0, 0, 0), XSize=sp_width, YSize=sp_height, Radius=0)  # -> Rectangle, Length
boundary = BoundarySurfaces(Edges=rectangle.Rectangle)
Z = UnitZ(Factor=sp_length)
extr = Extrude(Base=boundary, Direction=Z)
rh_out_sp_brep = Brep(extr)
debrep = DeconstructBrep(Brep=extr)  # -> Faces, Edges, Vertices
item = ListItem(List=debrep.Faces, Index="0", Wrap=True)
item_2 = ListItem(List=debrep.Faces, Index="5", Wrap=True)
area = Area(Geometry=item)  # -> Area, Centroid
area_2 = Area(Geometry=item_2)  # -> Area, Centroid
pl_origin = PlaneOrigin(Base=item, Origin=area.Centroid)
pl_origin_2 = PlaneOrigin(Base=item_2, Origin=area_2.Centroid)
pflip = FlipPlane(Plane=pl_origin, ReverseX=False, ReverseY=False, SwapAxes=True)
rh_out_sp_interface1 = Plane(pflip)
rh_out_sp_interface2 = Plane(pl_origin_2)
deplane = DeconstructPlane(Plane=rh_out_sp_interface1)  # -> Origin, XAxis, YAxis, ZAxis
deplane_2 = DeconstructPlane(Plane=rh_out_sp_interface2)  # -> Origin, XAxis, YAxis, ZAxis
vdis = VectorDisplay(Anchor=deplane.Origin, Vector=deplane.ZAxis)
vdis_2 = VectorDisplay(Anchor=deplane_2.Origin, Vector=deplane_2.ZAxis)
